# Dynamo graph Delete View Templates Script.dyn (Dynamo 3.0.3.7597)

# note: eduardo ibarra

# group: Documentation and User Guide > Python Libraries: Class Development
# note: #laloibarra
# #github/archeduardo5
# import clr
# clr.AddReference("RevitServices")
# clr.AddReference("RevitAPI")
# from RevitServices.Persistence import DocumentManager
# from RevitServices.Transactions import TransactionManager
# from Autodesk.Revit.DB import FilteredElementCollector, View, Transaction
# from System.Collections.Generic import List
# from datetime import datetime
# def log_deletion(template_name, status, error_msg=None):
#     """Helper function to format deletion logs"""
#     timestamp = datetime.now().strftime("%Y-%m-%d %H:%M:%S")
#     return f"[{timestamp}] Template: {template_name} - Status: {status}" + (f" - Error: {error_msg}" if error_msg else "")
# def delete_view_templates(doc, log_results=True):
#     """
#     Delete all view templates in the document with error handling and logging
#     Parameters:
#     doc: Revit document
#     log_results: Boolean to control logging
#     Returns:
#     tuple: (success_count, failed_count, log_messages, deleted_templates)
#     """
#     success_count = 0
#     failed_count = 0
#     log_messages = []
#     deleted_templates = []
#     try:
#         # Collect all view templates before starting transaction
#         view_templates = [view for view in FilteredElementCollector(doc).OfClass(View).ToElements()
#                          if view.IsTemplate]
#         if not view_templates:
#             return 0, 0, ["No view templates found in the document."], []
#         # Start transaction
#         TransactionManager.Instance.EnsureInTransaction(doc)
#         # Process each template
#         for view in view_templates:
#             try:
#                 template_name = view.Name
#                 doc.Delete(view.Id)
#                 success_count += 1
#                 deleted_templates.append(template_name)
#                 if log_results:
#                     log_messages.append(log_deletion(template_name, "Deleted Successfully"))
#             except Exception as template_error:
#                 failed_count += 1
#                 if log_results:
#                     log_messages.append(log_deletion(template_name, "Failed", str(template_error)))
#         # Commit transaction
#         TransactionManager.Instance.TransactionTaskDone()
#     except Exception as e:
#         # Handle any overall process errors
#         error_msg = f"Process failed: {str(e)}"
#         log_messages.append(error_msg)
#         return 0, 0, [error_msg], []
#     return success_count, failed_count, log_messages, deleted_templates
# # Main execution
# try:
#     input_value = IN[0]
#     doc = DocumentManager.Instance.CurrentDBDocument
#     if not input_value:
#         OUT = "Set input to True to proceed with template deletion"
#     else:
#         # Execute deletion with logging
#         success_count, failed_count, logs, deleted_templates = delete_view_templates(doc)
#         # Prepare output summary
#         summary = f"""
#         Operation Complete:
#         - Successfully deleted: {success_count} templates
#         - Failed deletions: {failed_count} templates
#         - Total processed: {success_count + failed_count} templates
#         """
#         OUT = summary, deleted_templates, logs
# except Exception as e:
#     OUT = f"Script execution failed: {str(e)}"

# group: Documentation and User Guide > AEC Script User Instructions
# note: """
# Instructions for the Revit View Template Deletion Script
# Description:
# This script is designed to delete all view templates in a Revit document.
# It logs the status of each deletion, whether successful or failed, and provides a summary at the end.
# Requirements:
# - This script must be run in the Dynamo environment for Revit.
# - Ensure you have permissions to delete elements in the current Revit project.
# Usage:
# 1. Import the script into Dynamo and connect it to an input node.
# 2. Provide a boolean input value to the input node:
#    - `True`: It will proceed with the deletion of view templates.
#    - `False` or empty: It will not perform any action.
# 3. Run the script.
# Output:
# - The script returns a summary of the operation, which includes:
#   - Number of templates successfully deleted.
#   - Number of failed deletions.
#   - List of deleted templates.
#   - Detailed logs of the operations.

# group: Delete View Templates Script
boolean = BoolSelector(true)
python_script = Python(IN[0]=boolean)  # CPython3
# ---------- python_script.python (95 lines) ----------
#laloibarra
#github/archeduardo5



import clr
clr.AddReference("RevitServices")
clr.AddReference("RevitAPI")
from RevitServices.Persistence import DocumentManager
from RevitServices.Transactions import TransactionManager
from Autodesk.Revit.DB import FilteredElementCollector, View, Transaction
from System.Collections.Generic import List
from datetime import datetime

def log_deletion(template_name, status, error_msg=None):
    """Helper function to format deletion logs"""
    timestamp = datetime.now().strftime("%Y-%m-%d %H:%M:%S")
    return f"[{timestamp}] Template: {template_name} - Status: {status}" + (f" - Error: {error_msg}" if error_msg else "")

def delete_view_templates(doc, log_results=True):
    """
    Delete all view templates in the document with error handling and logging
    
    Parameters:
    doc: Revit document
    log_results: Boolean to control logging
    
    Returns:
    tuple: (success_count, failed_count, log_messages, deleted_templates)
    """
    success_count = 0
    failed_count = 0
    log_messages = []
    deleted_templates = []
    
    try:
        # Collect all view templates before starting transaction
        view_templates = [view for view in FilteredElementCollector(doc).OfClass(View).ToElements()
                         if view.IsTemplate]
        
        if not view_templates:
            return 0, 0, ["No view templates found in the document."], []
        
        # Start transaction
        TransactionManager.Instance.EnsureInTransaction(doc)
        
        # Process each template
        for view in view_templates:
            try:
                template_name = view.Name
                doc.Delete(view.Id)
                success_count += 1
                deleted_templates.append(template_name)
                if log_results:
                    log_messages.append(log_deletion(template_name, "Deleted Successfully"))
                    
            except Exception as template_error:
                failed_count += 1
                if log_results:
                    log_messages.append(log_deletion(template_name, "Failed", str(template_error)))
        
        # Commit transaction
        TransactionManager.Instance.TransactionTaskDone()
        
    except Exception as e:
        # Handle any overall process errors
        error_msg = f"Process failed: {str(e)}"
        log_messages.append(error_msg)
        return 0, 0, [error_msg], []
    
    return success_count, failed_count, log_messages, deleted_templates

# Main execution
try:
    input_value = IN[0]
    doc = DocumentManager.Instance.CurrentDBDocument
    
    if not input_value:
        OUT = "Set input to True to proceed with template deletion"
    else:
        # Execute deletion with logging
        success_count, failed_count, logs, deleted_templates = delete_view_templates(doc)
        
        # Prepare output summary
        summary = f"""
        Operation Complete:
        - Successfully deleted: {success_count} templates
        - Failed deletions: {failed_count} templates
        - Total processed: {success_count + failed_count} templates
        """
        
        OUT = summary, deleted_templates, logs

except Exception as e:
    OUT = f"Script execution failed: {str(e)}"
# ----------------------------------------
watch = Watch(python_script)
